# Grasshopper definition Blowing Bubbles 2.gh (Grasshopper 1.0.8)
# plug-ins: Vipers, Weaverbird

number_slider = Slider(60, range=0..100)
sph = Sphere(Base=PlaneXY(0, 0, 0), Radius=number_slider)
pop3d = Populate3D(Region=sph, Count=Slider(40, range=0..100), Seed=Slider(4, range=0..10))
brepinc = PointInBrep(Brep=sph, Point=pop3d, Strict=True)
cull = CullPattern(List=pop3d, CullPattern=brepinc)
dom = ConstructDomain(DomainStart=Slider(10, range=0..20), DomainEnd=Slider(20, range=0..20))
lng = ListLength(List=cull)
random = Random(Range=dom, Number=lng, Seed=Slider(6, range=0..10))
sph_2 = Sphere(Base=cull, Radius=random)
triremesh = TriRemesh(Geometry=sph_2, Length=Slider(2, range=0..5), Iterations=25)  # -> Triangulation, Dual, Creases

addition = Addition(A=number_slider, B="20")
sph_3 = Sphere(Base=PlaneXY(0, 0, 0), Radius=addition)
polygonb = TriangularPolyhedron(ReferencePlane=PlaneXY(0, 0, 0), Radius=addition, Cover=False, PolyB1=True, PolyB2=False, PolyB3=False)  # -> Outline, Polyhedron
polygonb_2 = TriangularPolyhedron(ReferencePlane=PlaneXY(0, 0, 0), Radius="2", Cover=False, PolyB1=True, PolyB2=False, PolyB3=False)  # -> Outline, Polyhedron
wbunify = WeaverbirdsUnifyFaceWindings(MeshCurves=polygonb_2.Outline)
wbunify_2 = WeaverbirdsUnifyFaceWindings(MeshCurves=polygonb.Outline)
boundary = BoundarySurfaces(Edges=wbunify)
boundary_2 = BoundarySurfaces(Edges=wbunify_2)
pcen = PolygonCenter(Polyline=boundary)  # -> CenterV, CenterE, CenterA
pt = Point(Point(0, 0, 0))
vec2pt = Vector2Pt(PointA=pt, PointB=pcen.CenterV, Unitize=False)  # -> Vector, Length
extr = Extrude(Base=boundary_2, Direction=vec2pt.Vector)
triremesh_2 = TriRemesh(Geometry=extr, Length=Slider(2.5, range=0..5), Iterations=25)  # -> flatten(Triangulation), Dual, Creases; disabled

wbedges = WeaverbirdsMeshEdges(MeshOrPolylines=triremesh.Triangulation)
demesh = DeconstructMesh(Mesh=triremesh.Triangulation)  # -> Vertices, Faces, Colours, Normals
len = Length(Curve=wbedges)
pressure = Pressure(M=triremesh.Triangulation, Strength=Slider(1, range=0..5))
length_line = LengthLine(Line=wbedges, Length=len, Strength=Slider(20, range=0..100))
spc = SolidPointCollide(
    Points=demesh.Vertices,
    Solid=triremesh_2.Triangulation,
    Interior=Toggle(False),
    Unidirectional=Toggle(True),
    Strength=Slider(8000, range=0..100000))
show = Show(G=triremesh.Triangulation)
merge = Merge(Data1=length_line, Data2=pressure, Data3=spc)
entwine = Entwine(Branch00=show, Branch01=merge, FlattenInputs=True)

subtraction = Subtraction(A=lng, B="1")
bouncysolver = BouncySolver(GoalObjects=entwine, Reset=Button(), Threshold=1e-15, Tolerance=0.0001, Damping=0.99, Iterations="5", On=Toggle(False))  # -> I, V, O
dom_2 = ConstructDomain(DomainStart="0", DomainEnd=subtraction)
subset = SubList(List=bouncysolver.O, Domain=dom_2, Wrap=True)  # -> List, Index

mesh = Mesh(subset.List)
munion = MeshUnion(Meshes=mesh)
mjoin = MeshJoin(Meshes=munion)
wbloop = WeaverbirdsLoopSubdivision(MeshCurves=mjoin, Level=Slider(3, range=0..10), SmoothNakedEdges=1)
qrsettings = QuadRemeshSettings(TargetCount=2000, AdaptiveSize=0, AdaptiveCount=False, HardEdges=False, SeamEdges=0, Symmetry=0, GuideCurves=0)
qrmesh = QuadRemesh(Geometry=wbloop, Settings=qrsettings)
subdmesh = SubDFromMesh(Mesh=qrmesh, Creases=1, Corners=1, Interpolate=False)
